# Grasshopper definition Facade_screen.gh (Grasshopper 1.0.7)
# plug-ins: LunchBox

facade_depth = Slider(2, range=0..10)
screen_height = Slider(6, range=2..10)
screen_length = Slider(16, range=5..30)
number_slider = Slider(2, range=0..10)
rotationangle = Slider(116, range=0..180)
aperturescale = Slider(48, range=5..95)
attractor_strength = Slider(10, range=0..10)

facade_depth_2 = GetNumber(facade_depth, AtLeast=1, AtMost=2147483647, Maximum=1.797693135e+308, Minimum=-1.797693135e+308)
panel = Panel("""2
3""")
Y = UnitY(Factor=facade_depth_2)
screen_length_2 = GetNumber(screen_length, AtLeast=1, AtMost=2147483647, Maximum=1.797693135e+308, Minimum=-1.797693135e+308)
screen_height_2 = GetNumber(screen_height, AtLeast=1, AtMost=2147483647, Maximum=1.797693135e+308, Minimum=-1.797693135e+308)
xz = XZPlane(Origin=Point(0, 0, 0))
move = Move(Geometry=xz, Motion=Y)  # -> Geometry, Transform
rectangle = Rectangle(Plane=move.Geometry, XSize=screen_length_2, YSize=screen_height_2, Radius=0)  # -> Rectangle, Length
debrep = DeconstructBrep(Brep=rectangle.Rectangle)  # -> Faces, Edges, Vertices
rectangle_2 = Rectangle(Plane=xz, XSize=screen_length_2, YSize=screen_height_2, Radius=0)  # -> Rectangle, Length
debrep_2 = DeconstructBrep(Brep=rectangle_2.Rectangle)  # -> Faces, Edges, Vertices
ln = Line(StartPoint=debrep_2.Vertices, EndPoint=debrep.Vertices)
item = ListItem(List=ln, Index=panel, Wrap=True)
end = EndPoints(Curve=item)  # -> Start, End
item_2 = ListItem(List=end.Start, Index=0, Wrap=True)
item_3 = ListItem(List=end.End, Index="1", Wrap=True)
loft = Loft(Curves=item, Options={Adjust=False, Closed=False, LoftEnds=0, LoftSimp=0, LoftType=0, Rebuild=10, Refit=0.01})
boundary = BoundarySurfaces(Edges=rectangle.Rectangle)
boundary_curve = Curve(rectangle.Rectangle)
ln_2 = Line(StartPoint=item_2, EndPoint=item_3)
merge = Merge(Data1=boundary, Data2=loft)
midpt = CurveMiddle(Curve=ln_2)
number_slider_2 = Slider(15, range=0..100)
project = Project(Geometry=midpt, Plane=PlaneXY(0, 0, 0))  # -> Geometry, Transform
addition = Addition(A=screen_length, B=Slider(1, range=0..10))
cir = Circle(Plane=project.Geometry, Radius=addition)
srf = Surface(cir)
aperturescale_2 = GetNumber(aperturescale, AtLeast=1, AtMost=2147483647, Maximum=1.797693135e+308, Minimum=-1.797693135e+308)
division = Division(A=aperturescale_2, B=Slider(100, range=0..100))
rotationangle_2 = GetNumber(rotationangle, AtLeast=1, AtMost=2147483647, Maximum=1.797693135e+308, Minimum=-1.797693135e+308)
attractor_strength_2 = GetNumber(attractor_strength, AtLeast=1, AtMost=2147483647, Maximum=1.797693135e+308, Minimum=-1.797693135e+308)
number_slider_3 = Slider(0.03, range=0..1)  # disabled
number_slider_4 = Slider(0.92, range=0..1)  # disabled
dom = ConstructDomain(DomainStart=Slider(0.01, range=0.01..1), DomainEnd=division)
dom_2 = ConstructDomain(DomainStart=number_slider_4, DomainEnd=number_slider_3)  # disabled

# ---- group: RH_OUT:mesh
mesh = Mesh(flatten(merge))

# ---- group: RH_OUT_Surface
mesh_2 = Mesh(srf)

# ----
boundary_curve_2 = Curve(rectangle_2.Rectangle)

debrep_3 = DeconstructBrep(Brep=boundary_curve_2)  # -> Faces, Edges, Vertices
bang = ExplodeTree(Data=graft(debrep_3.Edges))  # -> Branch0, Branch1, Branch2, Branch3
number_slider_5 = Slider(24, range=0..100)
curvepoint = PointOnCurve(bang.Branch3, parameter=0.5)
curvepoint_2 = PointOnCurve(bang.Branch1, parameter=0.5)
ln_3 = Line(StartPoint=curvepoint, EndPoint=curvepoint_2)
range = Range(Domain=Domain(0, 1), Steps=number_slider_5)
divide = DivideCurve(Curve=ln_3, Count=number_slider_5, Kinks=False)  # -> Points, Tangents, Parameters
graph = GraphMapper(range, x0=0, x1=-1, y0=0, y1=1, container_name="Sine", Equation_px=[0, 0.507895112], Equation_py=[0, 0.9974124432])
neg = Negative(Value=number_slider)
dom_3 = ConstructDomain(DomainStart=number_slider, DomainEnd=neg)
remap = RemapNumbers(Value=graph, Source=Domain(0, 1), Target=graft(dom_3))  # -> Mapped, Clipped
Z = UnitZ(Factor=remap.Mapped)
move_2 = Move(Geometry=divide.Points, Motion=Z)  # -> Geometry, Transform
intcrv = Interpolate(Vertices=move_2.Geometry, Degree=3, Periodic=False, KnotStyle=1)  # -> Curve, Length, Domain

attractor_crv = Curve(intcrv.Curve)

area = Area(Geometry=boundary_curve_2)  # -> Area, Centroid
xz_2 = XZPlane(Origin=area.Centroid)
srf_2 = Surface(boundary_curve_2)
rotate = Rotate(Geometry=attractor_crv, Angle=degrees(rotationangle_2), Plane=xz_2)  # -> Geometry, Transform
trib = TrianglePanelsB(Surface=srf_2, UDivisions=Slider(54, range=0..100), VDivisions=Slider(34, range=0..100))
area_2 = Area(Geometry=trib)  # -> Area, Centroid
pull = PullPoint(Point=area_2.Centroid, Geometry=rotate.Geometry, ClosestOnly=True)  # -> ClosestPoint, Distance
min = Minimum(A=pull.Distance, B=attractor_strength_2)
panel_2 = Panel(min)
bnd = Bounds(Numbers=min)
remap_2 = RemapNumbers(Value=min, Source=bnd, Target=dom)  # -> Mapped, Clipped
scale = Scale(Geometry=trib, Center=area_2.Centroid, Factor=remap_2.Mapped)  # -> Geometry, Transform

crv = Curve(flatten(scale.Geometry))
crv_2 = Curve(boundary_curve_2)
merge_2 = Merge(Data1=crv_2, Data2=crv)

screen_centre_pt = Point(area.Centroid)
area_3 = Area(Geometry=merge_2)  # -> Area, Centroid
pull_2 = PullPoint(Point=area_3.Centroid, Geometry=screen_centre_pt, ClosestOnly=True)  # -> ClosestPoint, Distance
len = Length(Curve=merge_2)
bnd_2 = Bounds(Numbers=pull_2.Distance)
remap_3 = RemapNumbers(Value=pull_2.Distance, Source=bnd_2, Target=Domain(0, 1))  # -> Mapped, Clipped
cull_i = CullIndex(List=area_3.Area, Indices="0", Wrap=True)
cull_i_2 = CullIndex(List=len, Indices="0", Wrap=True)
gradient = Gradient(
    LowerLimit=0,
    UpperLimit=1,
    Parameter=remap_3.Mapped,
    stops=[0: RGB(0, 34, 255), 0.5: RGB(255, 0, 85), 1: RGB(255, 153, 0)])
gradient_2 = Gradient(
    LowerLimit=0,
    UpperLimit=1,
    Parameter=remap_3.Mapped,
    stops=[0: RGB(0, 98, 0), 0.25: RGB(81, 175, 17), 0.5: RGB(159, 198, 146), 0.75: RGB(170, 235, 41), 1: RGB(221, 255, 53)])
num = Number(cull_i_2)
num_2 = Number(cull_i)
c_script = CSharpScript(crv=merge_2, color=gradient, length=num, area=num_2)  # -> out, A, B, C; inputs crv: Curve, color: Color, length: String, area: String
# ---------- c_script: C# ----------
    var c = color.R + "," + color.G + "," + color.B;
    crv.SetUserString("color", c);
    A = crv;
    var d = length;
    crv.SetUserString("length", d);
    B = length;
    var e = area;
    crv.SetUserString("area", e);
    C = area;
# ---------- end c_script ----------
panel_3 = Panel(c_script.C)
panel_4 = Panel(c_script.B)

# ---- group: RH_OUT:edges
curve = Curve(flatten(c_script.A))
