# Grasshopper definition Facade_screen_II.gh (Grasshopper 1.0.7)
# plug-ins: Pufferfish

maximum_circle_size = Slider(0.15, range=0.01..3)
circle_minimum_size_cull_threshold = Slider(0.05, range=0..0.2)

context_depth = Slider(7, range=1..10)
number_of_random_points = Slider(18, range=1..50)
random_seed = Slider(54.7, range=0..100)
attractor_distance_scaling_factor = Slider(7, range=3..50)
polygon_sides = Slider(6, range=3..7)
screen_length = Slider(18, range=5..30)
screen_height = Slider(6, range=2..10)
shape_type = Slider(1, range=0..1)
rotationangle = Slider(56, range=0..180)
aperturescale = Slider(93, range=20..100)
facade_depth = Slider(3, range=0..10)

# ---- group: Non-variable
context_thickness = Slider(0.2, range=0..1)

# ----
context_thickness_2 = Number(context_thickness)
_2 = Number(2)
number = Number(2.5)
screen_length_2 = GetNumber(screen_length, AtLeast=1, AtMost=2147483647, Maximum=1.797693135e+308, Minimum=-1.797693135e+308)
screen_height_2 = GetNumber(screen_height, AtLeast=1, AtMost=2147483647, Maximum=1.797693135e+308, Minimum=-1.797693135e+308)
polygon_sides_2 = GetNumber(polygon_sides, AtLeast=1, AtMost=2147483647, Maximum=1.797693135e+308, Minimum=-1.797693135e+308)
shape_type_2 = GetNumber(shape_type, AtLeast=0, AtMost=1, Maximum=1.797693135e+308, Minimum=-1.797693135e+308)
random_points = GetNumber(number_of_random_points, AtLeast=1, AtMost=50, Maximum=1.797693135e+308, Minimum=-1.797693135e+308)
random_seed_2 = GetNumber(random_seed, AtLeast=1, AtMost=2147483647, Maximum=1.797693135e+308, Minimum=-1.797693135e+308)
attractor_weight = GetNumber(attractor_distance_scaling_factor, AtLeast=1, AtMost=2147483647, Maximum=1.797693135e+308, Minimum=-1.797693135e+308)
context_depth_2 = GetNumber(context_depth, AtLeast=1, AtMost=2147483647, Maximum=1.797693135e+308, Minimum=-1.797693135e+308)
multiplication = Multiplication(A=screen_length, B=_2)
multiplication_2 = Multiplication(A=screen_height, B=number)
context_thickness_3 = Number(context_thickness_2)
xz = XZPlane(Origin=Point(0, 0, 0))
addition = Addition(A=screen_height_2, B=context_thickness_3)
aperturescale_2 = GetNumber(aperturescale, AtLeast=1, AtMost=2147483647, Maximum=1.797693135e+308, Minimum=-1.797693135e+308)
facade_depth_2 = GetNumber(facade_depth, AtLeast=1, AtMost=2147483647, Maximum=1.797693135e+308, Minimum=-1.797693135e+308)
rotationangle_2 = GetNumber(rotationangle, AtLeast=1, AtMost=2147483647, Maximum=1.797693135e+308, Minimum=-1.797693135e+308)
rectangle = Rectangle(Plane=xz, XSize=screen_length_2, YSize=screen_height_2, Radius=0)  # -> Rectangle, Length
rectangle_2 = Rectangle(Plane=xz, XSize=screen_length_2, YSize=addition, Radius=0)  # -> Rectangle, Length
boundary_crv = Curve(rectangle.Rectangle)
Y = UnitY(Factor=facade_depth_2)

# ---- group: Setup Grid within Initial Boundary Curve
boundary = BoundarySurfaces(Edges=boundary_crv)
divide = DivideDomain²(Domain=boundary, UCount=multiplication, VCount=multiplication_2)
subsrf = Isotrim(Surface=boundary, Domain=divide)  # -> flatten(Surface)

# ----
boundary_curve = Curve(rectangle_2.Rectangle)

area = Area(Geometry=boundary_crv)  # -> Area, Centroid
pop2d = Populate2D(Region=boundary_crv, Count=random_points, Seed=random_seed_2)
facade_centre = Point(area.Centroid)
random_points_2 = Point(pop2d)

move = Move(Geometry=boundary_curve, Motion=Y)  # -> Geometry, Transform
innerfacade_curve = Curve(move.Geometry)
area_2 = Area(Geometry=subsrf)  # -> Area, Centroid
context_thickness_4 = Number(context_thickness_2)
debrep = DeconstructBrep(Brep=boundary_curve)  # -> Faces, Edges, Vertices
debrep_2 = DeconstructBrep(Brep=innerfacade_curve)  # -> Faces, Edges, Vertices
panel = Panel("""2
3""")
xz_2 = XZPlane(Origin=area_2.Centroid)
ln = Line(StartPoint=debrep.Vertices, EndPoint=debrep_2.Vertices)
join = JoinCurves(Curves=debrep.Edges, Preserve=False)  # -> graft(Curves)
item = ListItem(List=ln, Index=panel, Wrap=True)
division = Division(A=context_thickness_4, B="5")
end = EndPoints(Curve=item)  # -> Start, End
pipe = Pipe(Curve=join, Radius=division, Caps=0)
item_2 = ListItem(List=end.Start, Index=0, Wrap=True)
item_3 = ListItem(List=end.End, Index="1", Wrap=True)
loft = Loft(Curves=item, Options={Adjust=False, Closed=False, LoftEnds=0, LoftSimp=0, LoftType=0, Rebuild=10, Refit=0.01})
Y_2 = UnitY(Factor=context_depth_2)
ln_2 = Line(StartPoint=item_2, EndPoint=item_3)
move_2 = Move(Geometry=debrep_2.Edges, Motion=Y_2)  # -> Geometry, Transform
cull_i = CullIndex(List=debrep_2.Edges, Indices=Slider(0, range=0..3), Wrap=True)
midpt = CurveMiddle(Curve=ln_2)
boundary_2 = BoundarySurfaces(Edges=move_2.Geometry)
project = Project(Geometry=midpt, Plane=PlaneXY(0, 0, 0))  # -> Geometry, Transform
addition_2 = Addition(A=screen_length_2, B=Slider(1, range=0..10))
extr = Extrude(Base=cull_i, Direction=Y_2)
cir = Circle(Plane=project.Geometry, Radius=addition_2)
neg = Negative(Value=context_thickness_4)
Y_3 = UnitY(Factor=Slider(0.02, range=0..1))
offsrf = OffsetSurface(Surface=loft, Distance=context_thickness_4, BothSides=0, CreateSolid=True)
offsrf_2 = OffsetSurface(Surface=extr, Distance=neg, BothSides=0, CreateSolid=True)
offsrf_3 = OffsetSurface(Surface=boundary_2, Distance=neg, BothSides=0, CreateSolid=True)
Z = UnitZ(Factor=Slider(0.5, range=0..1))
srf = Surface(cir)
number_slider = Slider(1, range=0..1)
extr_2 = Extrude(Base=srf, Direction=Z)
merge = Merge(Data1=offsrf, Data2=flatten(offsrf_2), Data3=offsrf_3, Data4=pipe)
custom_mesh_settings = SettingsCustom(
    StitchSeams=True,
    SimplePlanes=False,
    Refine=True,
    MinCount=16,
    MaxCount=400,
    AspectRatio=20,
    MaxDistance=0,
    MaxAngle=20,
    MinEdge=0,
    MaxEdge=0)
custom_mesh_settings_2 = SettingsCustom(
    StitchSeams=True,
    SimplePlanes=False,
    Refine=True,
    MinCount=16,
    MaxCount=400,
    AspectRatio=20,
    MaxDistance=0,
    MaxAngle=20,
    MinEdge=0,
    MaxEdge=0)

# ---- group: RH_OUT:Context
mesh = Mesh(flatten(merge))

# ---- group: RH_OUT_Surface
mesh_2 = Mesh(flatten(extr_2))

# ---- group: Calculate Radius based on Attractor Logic
cp = ClosestPoint(Point=area_2.Centroid, Cloud=random_points_2)  # -> ClosestPoint, CPIndex, Distance
division_2 = Division(A=cp.Distance, B=attractor_weight)
min = Minimum(A=division_2, B=maximum_circle_size)

# ----
larger = LargerThan(FirstNumber=min, SecondNumber=circle_minimum_size_cull_threshold)  # -> LargerThan, OrEqualTo

# ---- group: Calculate Radius based on Attractor Logic (continued)
cull = CullPattern(List=cp.Distance, CullPattern=larger.LargerThan)
bnd = Bounds(Numbers=cull)
range_of_distances = Panel(bnd)

# ----
polygon = Polygon(Plane=xz_2, Radius=min, Segments=polygon_sides_2, FilletRadius=0)  # -> Polygon, Length
cir_2 = Circle(Plane=xz_2, Radius=min)
filter = StreamFilter(Gate=shape_type_2, Stream0=cir_2, Stream1=polygon.Polygon)
dedomain = DeconstructDomain(Domain=bnd)  # -> Start, End
gradient = Gradient(
    LowerLimit=dedomain.Start,
    UpperLimit=dedomain.End,
    Parameter=cull,
    stops=[0: RGB(0, 98, 0), 0.25: RGB(81, 175, 17), 0.5: RGB(159, 198, 146), 0.75: RGB(170, 235, 41), 1: RGB(221, 255, 53)])
gradient_2 = Gradient(
    LowerLimit=dedomain.Start,
    UpperLimit=dedomain.End,
    Parameter=cull,
    stops=[0: RGB(243, 57, 0), 0.1: RGB(236, 27, 60), 0.2: RGB(210, 0, 118), 0.3: RGB(103, 0, 120), 0.4: RGB(39, 72, 161), 0.5: RGB(1, 192, 229), 0.6: RGB(18, 178, 90), 0.7: RGB(79, 186, 8), 0.8: RGB(220, 237, 32), 0.9: RGB(247, 159, 20), 1: RGB(243, 57, 0)])
cull_2 = CullPattern(List=filter, CullPattern=larger.LargerThan)
extr_3 = Extrude(Base=cull_2, Direction=Y_3)
ahsv = SplitAHSV(Colour=gradient)  # -> Alpha, Hue, Saturation, Value
ahsv_2 = SplitAHSV(Colour=gradient_2)  # -> Alpha, Hue, Saturation, Value

# ---- group: Circle Output
geo = Geometry(cull_2)  # disabled

# ----
cap = CapHoles(Brep=extr_3)

# ---- group: Surface Endpt
boundary_3 = BoundarySurfaces(Edges=cull_2, UseTasks=True)  # disabled

# ----
hsv = ColourHSV(Alpha=number_slider, Hue=ahsv.Hue, Saturation=ahsv.Saturation, Value=ahsv.Value)
hsv_2 = ColourHSV(Alpha=number_slider, Hue=ahsv_2.Hue, Saturation=ahsv_2.Saturation, Value=ahsv_2.Value)
preview = CustomPreview(Geometry=cull_2, Material=hsv)

inner_crvs = Curve(flatten(cull_2))
merge_2 = Merge(Data2=inner_crvs)

mcol = MeshColours(Mesh=cap, Colours=hsv)
area_3 = Area(Geometry=merge_2)  # -> Area, Centroid
len = Length(Curve=merge_2)
num = Number(len)
num_2 = Number(area_3.Area)
c_script = CSharpScript(crv=merge_2, color=hsv_2, length=num, area=num_2)  # -> out, A, B, C; inputs crv: Curve, color: Color, length: String, area: String
# ---------- c_script: C# ----------
    var c = color.R + "," + color.G + "," + color.B;
    crv.SetUserString("color", c);
    A = crv;
    var d = length;
    crv.SetUserString("length", d);
    B = length;
    var e = area;
    crv.SetUserString("area", e);
    C = area;
# ---------- end c_script ----------
panel_2 = Panel(c_script.B)
panel_3 = Panel(c_script.C)

# ---- group: RH_OUT:mesh
mesh_3 = Mesh(flatten(mcol))

# ---- group: RH_OUT:edges
crv = Curve(c_script.A)
