# Grasshopper definition Facade_screen_lb.gh (Grasshopper 1.0.7)
# plug-ins: LunchBox

facade_depth = Slider(1, range=0..10)
screen_height = Slider(9, range=2..10)
screen_length = Slider(16, range=5..30)
number_slider = Slider(2, range=0..10)
rotationangle = Slider(82, range=0..180)
aperturescale = Slider(82, range=5..95)
attractor_strength = Slider(10, range=0..10)

facade_depth_2 = GetNumber(facade_depth, AtLeast=1, AtMost=2147483647, Maximum=1.797693135e+308, Minimum=-1.797693135e+308)
panel = Panel("""2
3""")
Y = UnitY(Factor=facade_depth_2)
screen_length_2 = GetNumber(screen_length, AtLeast=1, AtMost=2147483647, Maximum=1.797693135e+308, Minimum=-1.797693135e+308)
screen_height_2 = GetNumber(screen_height, AtLeast=1, AtMost=2147483647, Maximum=1.797693135e+308, Minimum=-1.797693135e+308)
xz = XZPlane(Origin=Point(0, 0, 0))
move = Move(Geometry=xz, Motion=Y)  # -> Geometry, Transform
rectangle = Rectangle(Plane=move.Geometry, XSize=screen_length_2, YSize=screen_height_2, Radius=0)  # -> Rectangle, Length
debrep = DeconstructBrep(Brep=rectangle.Rectangle)  # -> Faces, Edges, Vertices
rectangle_2 = Rectangle(Plane=xz, XSize=screen_length_2, YSize=screen_height_2, Radius=0)  # -> Rectangle, Length
debrep_2 = DeconstructBrep(Brep=rectangle_2.Rectangle)  # -> Faces, Edges, Vertices
ln = Line(StartPoint=debrep_2.Vertices, EndPoint=debrep.Vertices)
item = ListItem(List=ln, Index=panel, Wrap=True)
end = EndPoints(Curve=item)  # -> Start, End
item_2 = ListItem(List=end.Start, Index=0, Wrap=True)
item_3 = ListItem(List=end.End, Index="1", Wrap=True)
boundary = BoundarySurfaces(Edges=rectangle.Rectangle)
loft = Loft(Curves=item, Options={Adjust=False, Closed=False, LoftEnds=0, LoftSimp=0, LoftType=0, Rebuild=10, Refit=0.01})

Y_2 = UnitY(Factor=Slider(5, range=0..10))
facade_srf = Surface(boundary)
move_2 = Move(Geometry=facade_srf, Motion=Y_2)  # -> Geometry, Transform
rulesrf = RuledSurface(CurveA=facade_srf, CurveB=move_2.Geometry)
merge = Merge(Data1=rulesrf, Data2=move_2.Geometry)

ln_2 = Line(StartPoint=item_2, EndPoint=item_3)
boundary_curve = Curve(rectangle.Rectangle)
merge_2 = Merge(Data1=boundary, Data2=loft)
midpt = CurveMiddle(Curve=ln_2)
number_slider_2 = Slider(15, range=0..100)
project = Project(Geometry=midpt, Plane=PlaneXY(0, 0, 0))  # -> Geometry, Transform
addition = Addition(A=screen_length, B=Slider(1, range=0..10))
cir = Circle(Plane=project.Geometry, Radius=addition)
context_shading = Surface(merge)
srf = Surface(cir)
aperturescale_2 = GetNumber(aperturescale, AtLeast=1, AtMost=2147483647, Maximum=1.797693135e+308, Minimum=-1.797693135e+308)
division = Division(A=aperturescale_2, B=Slider(100, range=0..100))
rotationangle_2 = GetNumber(rotationangle, AtLeast=1, AtMost=2147483647, Maximum=1.797693135e+308, Minimum=-1.797693135e+308)
attractor_strength_2 = GetNumber(attractor_strength, AtLeast=1, AtMost=2147483647, Maximum=1.797693135e+308, Minimum=-1.797693135e+308)
number_slider_3 = Slider(0.03, range=0..1)  # disabled
number_slider_4 = Slider(0.92, range=0..1)  # disabled
dom = ConstructDomain(DomainStart=Slider(0.01, range=0.01..1), DomainEnd=division)
dom_2 = ConstructDomain(DomainStart=number_slider_4, DomainEnd=number_slider_3)  # disabled

# ---- group: RH_OUT:mesh
mesh = Mesh(flatten(merge_2))

# ---- group: RH_OUT_Surface
mesh_2 = Mesh(srf)

# ----
context_shading_2 = Surface(context_shading)
shading_srf = Surface(loft)

facade_srf_2 = Surface(boundary)
site_srf = Surface(srf)

# ----
# internalized
# geometries
context_shading_3 = Surface(context_shading_2)
facade_srf_3 = Surface(facade_srf_2)
site_srf_2 = Surface(srf)

# ----
# final massing geometries
# for detailed solar rad study
openingsforfinalmassing = Geometry([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])

finalmassing = Geometry(facade_srf_3)

# ----
# final massing
finalmassing_2 = Geometry([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])

shadingcontext = Geometry(context_shading_3)
sitegeometry = Geometry(site_srf_2)

# ----
# Site and context geom.
sitegeometry_2 = Geometry(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)
shadingcontext_2 = Geometry([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])

# ----
# use this cluster to find surface normals
shownormal = ShowNormal()

panel_2 = Panel("C:\Users\Gerald\Desktop\GERALD IAAC\TERM 2\2.S.3-Data_Management\Facade Screen Final Project\Rh + GH\CAPE_TOWN_SF-hour.epw")

# ----
# north arrow
pt = Point(Point(31.86861749, -39.97042362, 0))
northarrow = Ladybug_North(centerPt=pt)  # -> northSign; plug-in component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
preview = CustomPreview(Geometry=northarrow, Material=ColourSwatch(SwatchColor=RGB(13, 1, 1)))

# ----
# Prep work
# 1. Load LB
ladybug = Ladybug_Ladybug()  # -> Vviiiiiiiiiizzz; plug-in component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

# ----
# select specific hour
month = Slider(4, range=1..12)
day = Slider(1, range=1..31)
hour = Slider(15, range=1..24)

weather_data = Data(panel_2)

python = GhPythonScript(x=hour)  # -> a
# ---------- python: Python ----------
__author__ = "arisv"
__version__ = "2021.10.04"

if x < 24:
    a = x + 1
else:
     a = 1
# ---------- end python ----------
analysisperiod = Ladybug_AnalysisPeriod(fromMonth=month, fromDay=day, fromHour=hour, toMonth=month, toDay=day, toHour=python)  # -> readMe, analysisPeriod; plug-in component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

# ----
# 2. Load your *.epw weather file
importepw = Ladybug_ImportEpw(epwFile=weather_data)  # -> readMe, latitude, location, dryBulbTemperature, dewPointTemperature, relativeHumidity, windSpeed, windDirection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; plug-in component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

panel_3 = Panel(weather_data)

# ----
# Detailed solar irradiation study
# 6. set to 'True' to generate an annual cumulative sky
gencumulativesky = BooleanToggle(True)
gencumulativeskymtx = Ladybug_GenCumulativeSkyMtx(epwFile=weather_data, skyDensity=0, useOldRes=True, runIt=gencumulativesky)  # -> readMe, cumulativeSkyMtx; plug-in component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
selectskymtx = Ladybug_selectSkyMtx(
    cumulativeSkyMtx=gencumulativeskymtx.cumulativeSkyMtx,
    analysisPeriod=analysisperiod.analysisPeriod,
    removeDiffuse=False,
    removeDirect=False)  # -> readMe, selectedSkyMtx; plug-in component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

accountforlocalshading = BooleanToggle(True)
list = ValueList({"simulate Massing + site": 0, "simulate only Massing": 1, "simulate only windows": 2}, selected="simulate only Massing")

# ----
# visualization params.
swatch = ColourSwatch(SwatchColor=RGB(255, 132, 0))
legendpar = Ladybug_LegendParameters(
    customColors=flatten([ColourSwatch(SwatchColor=RGB(18, 11, 3)), swatch, ColourSwatch(SwatchColor=RGB(255, 251, 0)), ColourSwatch(SwatchColor=RGB(255, 254, 230))]),
    decimalPlaces="0")  # -> legendPar; plug-in component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

analysis_resolution = Panel("0.25")
analysis_resolution_2 = Panel("0.5")

boundary_curve_2 = Curve(rectangle_2.Rectangle)

debrep_3 = DeconstructBrep(Brep=boundary_curve_2)  # -> Faces, Edges, Vertices
bang = ExplodeTree(Data=graft(debrep_3.Edges))  # -> Branch0, Branch1, Branch2, Branch3
number_slider_5 = Slider(24, range=0..100)
curvepoint = PointOnCurve(bang.Branch3, parameter=0.5)
curvepoint_2 = PointOnCurve(bang.Branch1, parameter=0.5)
ln_3 = Line(StartPoint=curvepoint, EndPoint=curvepoint_2)
range = Range(Domain=Domain(0, 1), Steps=number_slider_5)
divide = DivideCurve(Curve=ln_3, Count=number_slider_5, Kinks=False)  # -> Points, Tangents, Parameters
graph = GraphMapper(range, x0=0, x1=-1, y0=0, y1=1, container_name="Sine", Equation_px=[0, 0.507895112], Equation_py=[0, 0.9974124432])
neg = Negative(Value=number_slider)
dom_3 = ConstructDomain(DomainStart=number_slider, DomainEnd=neg)
remap = RemapNumbers(Value=graph, Source=Domain(0, 1), Target=graft(dom_3))  # -> Mapped, Clipped
Z = UnitZ(Factor=remap.Mapped)
move_3 = Move(Geometry=divide.Points, Motion=Z)  # -> Geometry, Transform
intcrv = Interpolate(Vertices=move_3.Geometry, Degree=3, Periodic=False, KnotStyle=1)  # -> Curve, Length, Domain

attractor_crv = Curve(intcrv.Curve)

area = Area(Geometry=boundary_curve_2)  # -> Area, Centroid
xz_2 = XZPlane(Origin=area.Centroid)
srf_2 = Surface(boundary_curve_2)
rotate = Rotate(Geometry=attractor_crv, Angle=degrees(rotationangle_2), Plane=xz_2)  # -> Geometry, Transform
trib = TrianglePanelsB(Surface=srf_2, UDivisions=Slider(54, range=0..100), VDivisions=Slider(34, range=0..100))
area_2 = Area(Geometry=trib)  # -> Area, Centroid
pull = PullPoint(Point=area_2.Centroid, Geometry=rotate.Geometry, ClosestOnly=True)  # -> ClosestPoint, Distance
min = Minimum(A=pull.Distance, B=attractor_strength_2)
panel_4 = Panel(min)
bnd = Bounds(Numbers=min)
remap_2 = RemapNumbers(Value=min, Source=bnd, Target=dom)  # -> Mapped, Clipped
scale = Scale(Geometry=trib, Center=area_2.Centroid, Factor=remap_2.Mapped)  # -> Geometry, Transform

crv = Curve(flatten(scale.Geometry))
crv_2 = Curve(boundary_curve_2)
merge_3 = Merge(Data1=crv_2, Data2=crv)

screen_centre_pt = Point(area.Centroid)
area_3 = Area(Geometry=merge_3)  # -> Area, Centroid
pull_2 = PullPoint(Point=area_3.Centroid, Geometry=screen_centre_pt, ClosestOnly=True)  # -> ClosestPoint, Distance

srf_3 = Surface(crv_2)
srfsplit = SurfaceSplit(Surface=srf_3, Curves=flatten(crv))
item_4 = ListItem(List=srfsplit, Index=0, Wrap=True)

len = Length(Curve=merge_3)
bnd_2 = Bounds(Numbers=pull_2.Distance)
remap_3 = RemapNumbers(Value=pull_2.Distance, Source=bnd_2, Target=Domain(0, 1))  # -> Mapped, Clipped
cull_i = CullIndex(List=area_3.Area, Indices="0", Wrap=True)
cull_i_2 = CullIndex(List=len, Indices="0", Wrap=True)
gradient = Gradient(
    LowerLimit=0,
    UpperLimit=1,
    Parameter=remap_3.Mapped,
    stops=[0: RGB(0, 34, 255), 0.5: RGB(255, 0, 85), 1: RGB(255, 153, 0)])
gradient_2 = Gradient(
    LowerLimit=0,
    UpperLimit=1,
    Parameter=remap_3.Mapped,
    stops=[0: RGB(0, 98, 0), 0.25: RGB(81, 175, 17), 0.5: RGB(159, 198, 146), 0.75: RGB(170, 235, 41), 1: RGB(221, 255, 53)])
num = Number(cull_i_2)
num_2 = Number(cull_i)
screen_surface = Surface(item_4)
c_script = CSharpScript(crv=merge_3, color=gradient, length=num, area=num_2)  # -> out, A, B, C; inputs crv: Curve, color: Color, length: String, area: String
# ---------- c_script: C# ----------
    var c = color.R + "," + color.G + "," + color.B;
    crv.SetUserString("color", c);
    A = crv;
    var d = length;
    crv.SetUserString("length", d);
    B = length;
    var e = area;
    crv.SetUserString("area", e);
    C = area;
# ---------- end c_script ----------
panel_5 = Panel(c_script.C)
panel_6 = Panel(c_script.B)

# ---- group: RH_OUT:edges
curve = Curve(flatten(c_script.A))

# ----
screen_surface_2 = Surface(screen_surface)

screen_surface_3 = Surface(screen_surface_2)
shading_srf_2 = Surface(shading_srf)
merge_4 = Merge(Data1=shading_srf_2, Data2=screen_surface_3)
localshading = Geometry(merge_4)

openings = Geometry(openingsforfinalmassing)
sitegeometry_3 = Geometry(sitegeometry)
shadingcontext_3 = Geometry(shadingcontext)
shadingsurfaces = Geometry(localshading)
buildingmassing = Geometry(finalmassing)

# ----
# 3. Load your site geometry and context
area_4 = Area(Geometry=sitegeometry_3)  # -> Area, Centroid

siteandbuilding = Relay([buildingmassing, sitegeometry_3])
siteandcontext = Relay([sitegeometry_3, shadingcontext_3])

# ----
# preview
wires = BrepWireframe(Brep=siteandcontext, Density=-1)
preview_2 = CustomPreview(
    Geometry=wires,
    Material={diffuse=RGB(221, 160, 221), emission=RGB(66, 48, 66), shine=0.5, specular=RGB(255, 255, 255), transparency=0})

# ----
# 7. visualize sky dome
# Don't forget to select desired period!
number_slider_6 = Slider(0.5, range=0.1..1)
skydome = Ladybug_SkyDome(
    selectedSkyMtx=selectskymtx.selectedSkyMtx,
    centerPoint=area_4.Centroid,
    scale=number_slider_6,
    legendPar=legendpar,
    showTotalOnly=Toggle(True),
    runIt=Toggle(True))  # -> readMe, skyPatchesMesh, baseCrvs, altitudeCrvs, legend, legendBasePts, skyPatchesCenPts, skyPatchesAreas, skyPatchesAsBrep, values; plug-in component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

# ----
# 8. run annual solar irradiation study
selectskymtx_2 = Ladybug_selectSkyMtx(cumulativeSkyMtx=gencumulativeskymtx.cumulativeSkyMtx, removeDiffuse=False, removeDirect=False)  # -> readMe, selectedSkyMtx; plug-in component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
filter = StreamFilter(Gate=list, Stream0=siteandbuilding, Stream1=buildingmassing, Stream2=openings)
filter_2 = StreamFilter(Gate=accountforlocalshading, Stream0=shadingcontext_3, Stream1=[shadingsurfaces, shadingcontext_3])
analysis_resolution_3 = Panel("1")
radiationanalysis = Ladybug_RadiationAnalysis(
    geometry=flatten(filter),
    context=flatten(filter_2),
    gridSize=analysis_resolution_2,
    disFromBase="0.01",
    selectedSkyMtx=flatten(selectskymtx_2.selectedSkyMtx),
    legendPar=flatten(legendpar),
    parallel=Toggle(True),
    runIt=Toggle(True))  # -> readMe, contextMesh, analysisMesh, testPts, testVec, port, radiationResult, radiationMesh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; plug-in component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

# ----
# Note: Be cautious when using total irradiation as a performance metric!
# 
# Different surfaces have a different role in building energy budget!
# 
# This also depends on seasonal heating/cooling needs.
# Calculating seasonal solar irradiation just for window surfaces is a better metric.
total_radiation_kwh_m2 = Panel(radiationanalysis.totalRadiation)

# ----
# 9. run real time insolation study for custom period.
selectskymtx_3 = Ladybug_selectSkyMtx(
    cumulativeSkyMtx=gencumulativeskymtx.cumulativeSkyMtx,
    analysisPeriod=analysisperiod.analysisPeriod,
    removeDiffuse=False,
    removeDirect=False)  # -> readMe, selectedSkyMtx; plug-in component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
rtradiationanalysis = Ladybug_RealTimeRadiationAnalysis(selectedSkyMatrix=selectskymtx_3.selectedSkyMtx, intersectionMatrix=radiationanalysis.intersectionMtx)  # -> radiationResult; plug-in component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

legendpar_2 = Ladybug_LegendParameters(
    customColors=flatten([ColourSwatch(SwatchColor=RGB(18, 11, 3)), ColourSwatch(SwatchColor=RGB(255, 132, 0)), ColourSwatch(SwatchColor=RGB(255, 251, 0)), ColourSwatch(SwatchColor=RGB(255, 254, 230))]),
    decimalPlaces="2")  # -> legendPar; plug-in component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
recolormesh = Ladybug_RecolorMesh(
    analysisResult=rtradiationanalysis,
    inputMesh=radiationanalysis.radiationMesh,
    legendPar=legendpar_2,
    analysisTitle="insolation analysis",
    legendTitle="insolation(kWh/m2)")  # -> readMe, newMesh, newLegend, legendBasePt, meshColors, legendColors; plug-in component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

ma = MassAddition(Input=rtradiationanalysis)  # -> Result, PartialResults
total_insolation_kwh_m2 = Panel(ma.Result)

# ---- group: RH_OUT:Insolation
mesh_3 = Mesh(flatten(recolormesh.newMesh))

# ==== cluster ShowNormal
pluggeohere = ClusterInput()

# ----
# find surface normals
pluggeohere_2 = Geometry(pluggeohere)
evalsrf = EvaluateSurface(Surface=reparameterize(pluggeohere_2), Point="0.5,0.5")  # -> Point, Normal, UDirection, VDirection, Frame
amp = Amplitude(Vector=evalsrf.Normal, Amplitude="10")
vdisex = VectorDisplayEx(Point=evalsrf.Point, Vector=amp, Colour=RGB(0, 0, 0), Width=2)
