# Grasshopper definition Hari_v6.gh (Grasshopper 1.0.7)

lower_elbow_height = Slider(0.25, range=0.15..0.35)
mid_elbow_height = Slider(0.5, range=0.5..0.7)
upper_elbow_height = Slider(0.81, range=0.7..0.85)
elbow_bulge = Slider(1.21, range=1.15..1.35)
top_weight = Slider(0.97, range=0.83..0.99)
fin_radius = Slider(0.02, range=0..0.1)
base_rail_radius = Slider(0.03, range=0..0.1)  # disabled
top_rail_radius = Slider(0.02, range=0..0.1)  # disabled
height = Slider(0.68, range=0.3..1.2)
base_radius = Slider(0.91, range=0.25..1.5)
fins_count = Slider(40, range=10..40)

elbow_bulge_2 = Slider(0.9, range=0.85..0.95)
mid_elbow_height_2 = GetNumber(mid_elbow_height, AtLeast=1, AtMost=1, Maximum=1.797693135e+308, Minimum=-1.797693135e+308)
lower_elbow_height_2 = GetNumber(lower_elbow_height, AtLeast=1, AtMost=1, Maximum=1.797693135e+308, Minimum=-1.797693135e+308)
base_radius_2 = GetNumber(base_radius, AtLeast=1, AtMost=1, Maximum=1.797693135e+308, Minimum=-1.797693135e+308)
fins_count_2 = GetNumber(fins_count, AtLeast=1, AtMost=1, Maximum=1.797693135e+308, Minimum=-1.797693135e+308)
height_2 = GetNumber(height, AtLeast=1, AtMost=1, Maximum=1.797693135e+308, Minimum=-1.797693135e+308)
elbow_bulge_3 = GetNumber(elbow_bulge, AtLeast=1, AtMost=1, Maximum=1.797693135e+308, Minimum=-1.797693135e+308)
upper_elbow_height_2 = GetNumber(upper_elbow_height, AtLeast=1, AtMost=1, Maximum=1.797693135e+308, Minimum=-1.797693135e+308)
multiplication = Multiplication(A=fin_radius, B=Slider(1.5, range=0..10))
top_weight_2 = GetNumber(top_weight, AtLeast=1, AtMost=1, Maximum=1.797693135e+308, Minimum=-1.797693135e+308)
num = Number(height_2)
multiplication_2 = Multiplication(A=num, B=mid_elbow_height_2)
multiplication_3 = Multiplication(A=num, B=upper_elbow_height_2)
pt = ConstructPoint(XCoordinate=0, YCoordinate=0, ZCoordinate=0)
multiplication_4 = Multiplication(A=num, B=lower_elbow_height_2)
Z = UnitZ(Factor=multiplication_3)
Z_2 = UnitZ(Factor=multiplication_2)
Z_3 = UnitZ(Factor=num)
Z_4 = UnitZ(Factor=multiplication_4)
move = Move(Geometry=pt, Motion=Z_2)  # -> Geometry, Transform
move_2 = Move(Geometry=pt, Motion=Z)  # -> Geometry, Transform
multiplication_5 = Multiplication(A=elbow_bulge_3, B=elbow_bulge_2)
move_3 = Move(Geometry=pt, Motion=Z_4)  # -> Geometry, Transform
cir = Circle(Plane=move_2.Geometry, Radius=base_radius_2)
cir_2 = Circle(Plane=move.Geometry, Radius=base_radius_2)
move_4 = Move(Geometry=pt, Motion=Z_3)  # -> Geometry, Transform
multiplication_6 = Multiplication(A=base_radius_2, B=top_weight_2)
cir_3 = Circle(Plane=pt, Radius=base_radius_2)
cir_4 = Circle(Plane=move_3.Geometry, Radius=base_radius_2)
scale = Scale(Geometry=cir, Center=move_2.Geometry, Factor=multiplication_5)  # -> Geometry, Transform
scale_2 = Scale(Geometry=cir_2, Center=move.Geometry, Factor=elbow_bulge_3)  # -> Geometry, Transform
cir_5 = Circle(Plane=move_4.Geometry, Radius=multiplication_6)
base = Curve(cir_3)
scale_3 = Scale(Geometry=cir_4, Center=move_3.Geometry, Factor=elbow_bulge_3)  # -> Geometry, Transform
_75_elbow = Curve(scale.Geometry)
_50_elbow = Curve(scale_2.Geometry)
top = Curve(cir_5)
_25_elbow_mid = Curve(scale_3.Geometry)
divide = DivideCurve(Curve=base, Count=fins_count_2, Kinks=False)  # -> Points, Tangents, Parameters
divide_2 = DivideCurve(Curve=_25_elbow_mid, Count=fins_count_2, Kinks=False)  # -> Points, Tangents, Parameters
divide_3 = DivideCurve(Curve=_50_elbow, Count=fins_count_2, Kinks=False)  # -> Points, Tangents, Parameters
divide_4 = DivideCurve(Curve=_75_elbow, Count=fins_count_2, Kinks=False)  # -> Points, Tangents, Parameters
divide_5 = DivideCurve(Curve=top, Count=fins_count_2, Kinks=False)  # -> Points, Tangents, Parameters

# ---- group: Fix this curve
arc = Arc3Pt(PointA=divide.Points, PointB=divide_2.Points, PointC=divide_3.Points)  # -> Arc, Plane, Radius

# ----
arc_2 = Arc3Pt(PointA=divide_3.Points, PointB=divide_4.Points, PointC=divide_5.Points)  # -> Arc, Plane, Radius

# ---- group: Better method
merge = Merge(Data1=arc.Arc, Data2=arc_2.Arc)

# ----
join = JoinCurves(Curves=merge, Preserve=False)
top_2 = Curve(top)
base_2 = Curve(base)
pframes = PerpFrames(Curve=top_2, Count=10, Align=True)  # -> Frames, Parameters
number_slider = Slider(45, range=0..100)
pframes_2 = PerpFrames(Curve=base_2, Count=10, Align=True)  # -> Frames, Parameters
pframes_3 = PerpFrames(Curve=join, Count=10, Align=True)  # -> Frames, Parameters
pln = Plane(pframes.Frames)
pln_2 = Plane(pframes_2.Frames)
pln_3 = Plane(pframes_3.Frames)
polygon = Polygon(Plane=pln, Radius=fin_radius, Segments=Slider(4, range=0..10), FilletRadius=0)  # -> Polygon, Length
polygon_2 = Polygon(Plane=pln_2, Radius=multiplication, Segments=Slider(4, range=0..10), FilletRadius=0)  # -> Polygon, Length
polygon_3 = Polygon(Plane=pln_3, Radius=fin_radius, Segments=Slider(4, range=0..10), FilletRadius=0)  # -> Polygon, Length
rotate = Rotate(Geometry=polygon_3.Polygon, Angle=degrees(number_slider), Plane=pln_3)  # -> Geometry, Transform
rotate_2 = Rotate(Geometry=polygon_2.Polygon, Angle=degrees(number_slider), Plane=pln_2)  # -> Geometry, Transform
rotate_3 = Rotate(Geometry=polygon.Polygon, Angle=degrees(Slider(45, range=0..45)), Plane=pln)  # -> Geometry, Transform
loft = Loft(Curves=rotate.Geometry, Options={Adjust=False, Closed=False, LoftEnds=0, LoftSimp=0, LoftType=0, Rebuild=10, Refit=0.01})  # -> graft(Loft)
loft_2 = Loft(
    Curves=rotate_2.Geometry,
    Options={Adjust=False, Closed=True, LoftEnds=0, LoftSimp=0, LoftType=0, Rebuild=10, Refit=0.01})
loft_3 = Loft(
    Curves=rotate_3.Geometry,
    Options={Adjust=False, Closed=True, LoftEnds=0, LoftSimp=0, LoftType=0, Rebuild=10, Refit=0.01})
debrep = DeconstructBrep(Brep=loft_3)  # -> Faces, Edges, Vertices
item = ListItem(List=debrep.Faces, Index=Slider(1, range=0..3), Wrap=True)
merge_2 = Merge(Data1=loft, Data2=loft_2, Data3=loft_3)
edges = BrepEdges(Brep=item)  # -> Naked, Interior, NonManifold
item_2 = ListItem(List=edges.Naked, Index=0, Wrap=True)
area = Area(Geometry=item_2)  # -> Area, Centroid
mesh = MeshBrep(
    Brep=merge_2,
    Settings={GridMaxCount=0, GridMinCount=16, JaggedSeams=False, MaxEdgeLength=0, MinEdgeLength=0.0001, MinTolerance=0, Refine=True, RefineAngle=0, RelativeTolerance=0.65, SimplePlanes=True, Tolerance=0})
top_glass = Curve(item_2)
Z_5 = UnitZ(Factor=Slider(0.01, range=0..0.01))
mcol = MeshColours(Mesh=mesh, Colours=ColourSwatch(SwatchColor=RGB(227, 175, 138)))
boundary = BoundarySurfaces(Edges=top_glass)
neg = Negative(Value=Z_5)
extr = Extrude(Base=boundary, Direction=neg)
mesh_2 = MeshBrep(
    Brep=extr,
    Settings={GridMaxCount=0, GridMinCount=16, JaggedSeams=False, MaxEdgeLength=0, MinEdgeLength=0.0001, MinTolerance=0, Refine=True, RefineAngle=0, RelativeTolerance=0.65, SimplePlanes=True, Tolerance=0})

# ---- group: RH_OUT:Mesh
mesh_3 = Mesh(flatten(mcol))

# ---- group: RH_OUT:Glass
mesh_4 = Mesh(mesh_2)
